# Grasshopper definition sentiment.gh (Grasshopper 1.0.8)
# plug-ins: Human, Heron, eleFront5

# Reading textfiles (with Grasshopper)
cluster = Cluster()
path = FilePath("D:\1group D\tearm1\venice_sentiment_coordinates.csv")

# ---- group: Input
geo = Geometry([<point referenced from the Rhino model> x5000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])
y = Panel("30")
x = Panel("50")

# ----
file = ReadFile(File=path, PerLineParse=True)
panel = Panel(file)
cull_i = CullIndex(List=file, Indices="0", Wrap=True)

# ---- group: Inclusion
sqgrid = Square(Plane=PlaneXY(0, 0, 0), Size=1, ExtentX=x, ExtentY=y)  # -> flatten(Cells), Points
area = Area(Geometry=sqgrid.Cells)  # -> Area, Centroid
merge = Merge(Data1=geo, Data2=area.Centroid)
pt = Point(merge)
incurves = PointInCurves(Point=pt, Curves=sqgrid.Cells)  # -> Relationship, Index, Point

# ----
tab = Panel(",")
panel_2 = Panel(merge)
split = TextSplit(Text=cull_i, Separators=tab)
panel_3 = Panel(area.Centroid)
deconstruct = Deconstruct(Point=geo)  # -> XComponent, YComponent, ZComponent
panel_4 = Panel(split)
item = ListItem(List=split, Index="3", Wrap=True)  # -> Item, Item1, Item2, Item3, Item4, Item5
panel_5 = Panel(item.Item1)
panel_6 = Panel(item.Item2)

# ---- group: Check all cells
multiplication = Multiplication(A=x, B=y)
series = Series(Start=0, Step=1, Count=multiplication)  # -> simplify(graft(Series))
equals = Equality(FirstNumber=incurves.Index, SecondNumber=series)  # -> Equality, Inequality
cull = CullPattern(List=pt, CullPattern=equals.Equality)
panel_7 = Panel(cull)

# ----
# SPATIAL BINNING IN GRASSHOPPER
# Add contrast by "streching" the numbers
panel_8 = Panel(pt)
panel_9 = Panel(incurves.Index)
tstat = TreeStatistics(Tree=cull)  # -> Paths, Length, Count

# ---- group: Check one cell
equals_2 = Equality(FirstNumber=incurves.Index, SecondNumber="12")  # -> Equality, Inequality
cull_2 = CullPattern(List=pt, CullPattern=equals_2.Equality)

# ----
flatten_tree = FlattenTree(Tree=item.Item1, Path="{0}")
dispatch = Dispatch(List=deconstruct.ZComponent, DispatchPattern=equals.Equality)  # -> ListA, ListB
flatten_tree_2 = FlattenTree(Tree=item.Item, Path="{0}")
panel_10 = Panel(dispatch.ListA)
average = Average(Input=dispatch.ListA)
decimal_degrees_to_xy = DecimalDegreesToXY(Latitude=flatten_tree_2, Longitude=flatten_tree)  # -> XyPoint, Transform
geo_2 = Geometry(<curve referenced from the Rhino model>)

# ----
# Bake with attributes (optional)
panel_11 = Panel("5")
item_2 = ListItem(List=split, Index=panel_11, Wrap=True)
tstat_2 = TreeStatistics(Tree=item_2)  # -> Paths, Length, Count
dup = DuplicateData(Data="GSR", Number=tstat_2.Length, Order=True)  # -> simplify(Data)
ef_att = EleFrontAttributes(Keys=dup, Values=item_2, Layer="Points", maintainBakeName=False)  # -> flatten(Attributes), Keys, Values, Name, Layer, ColourSource, DisplayColour, MaterialSource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
bake = BakeObjects(Geometry=geo_2, Attributes=ef_att.Attributes, Bake=False, createGroups=False)  # -> Message, Ghosts

panel_12 = Panel(item_2)
panel_13 = Panel(dup)
multiplication_2 = Multiplication(B=Slider(100, range=0..10000))
multiplication_3 = Multiplication(B=Slider(100, range=0..10000))
panel_14 = Panel(average)
deconstruct_2 = Deconstruct(Point=decimal_degrees_to_xy.XyPoint)  # -> XComponent, YComponent, ZComponent
pt_2 = ConstructPoint(XCoordinate=multiplication_3, YCoordinate=multiplication_2, ZCoordinate=0)
panel_15 = Panel(tstat.Length)
construct_domain = ConstructDomain(DomainStart=Slider(0, range=0..100), DomainEnd=Slider(1000000, range=0..10000000))
panel_16 = Panel(pt_2)
replace_nulls = ReplaceNulls(Items=panel_14, Replacements=Slider(0, range=0..100))  # -> flatten(Items), Count
remap_numbers = RemapNumbers(Value=item.Item2, Source=Domain(0, 1), Target=construct_domain)  # -> flatten(Mapped), Clipped
panel_17 = Panel(replace_nulls.Items)

# ---- group: Surface Grid
bnd = Bounds(Numbers=flatten(panel_17))
dom = ConstructDomain(DomainStart="0", DomainEnd="16")
remap = RemapNumbers(Value=panel_17, Source=bnd, Target=dom)  # -> Mapped, Clipped
Z = UnitZ(Factor=remap.Mapped)
move = Move(Geometry=area.Centroid, Motion=Z)  # -> Geometry, Transform
srfgrid = SurfaceFromPoints(Points=move.Geometry, UCount=x, Interpolate=False)

# ----
panel_18 = Panel(Z)
pt_3 = ConstructPoint(XCoordinate=deconstruct_2.XComponent, YCoordinate=deconstruct_2.YComponent, ZCoordinate=0)
pt_4 = ConstructPoint(XCoordinate=deconstruct_2.XComponent, YCoordinate=deconstruct_2.YComponent, ZCoordinate=remap_numbers.Mapped)
panel_19 = Panel(pt_4)

# ---- group: Graphics & Baking
contour = Contour(Shape=srfgrid, Point=Point(0, 0, 0), Direction=Vector(0, 0, 1), Distance=Slider(0.117, range=0..1))
eval = EvaluateCurve(Curve=contour, Parameter=0)  # -> Point, Tangent, Angle
pdecon = Deconstruct(Point=eval.Point)  # -> XComponent, YComponent, ZComponent
bnd_2 = Bounds(Numbers=flatten(pdecon.ZComponent))
dedomain = DeconstructDomain(Domain=bnd_2)  # -> Start, End
gradient = Gradient(
    LowerLimit=dedomain.Start,
    UpperLimit=dedomain.End,
    Parameter=flatten(pdecon.ZComponent),
    stops=[0: RGB(234, 38, 0), 0.177: RGB(234, 126, 0), 0.332: RGB(254, 244, 84), 0.871: RGB(173, 203, 249), 1: RGB(75, 107, 169)])
preview = CustomPreview(Geometry=flatten(contour), Material=gradient)
createatts = CreateAttributes(LayerName="Contours", Color=gradient, enableFullPath=False)
# How do you read the result?
# 
# The first line isn0 | 21
# and that means that Point 0 is in
# curve 21
# 
# Same is true for
# 1 | 21
# 
# And the third line is 2 | 12
# and that means that point 2
# is in curve 12.
# Add contrast by "streching" the numbers
bake_2 = BakeGeometry(Bake=Button(), Geometry=flatten(contour), Attributes=createatts, DeleteOldBakes=False, PreserveTrees=False)

# ----
line = Line(StartPoint=pt_4, EndPoint=pt_3)

# ----
# Field values of OSM are here:
# https://wiki.openstreetmap.org/wiki/Map_features
# you can test example values here:
# https://www.openstreetmap.org/node/6429327326
# 
# The format is
# [Key],[Value]
filterfiields = Panel("natural")
path_2 = FilePath("D:\1group D\tearm2\field.trip\data\GH\map (2).osm")
# 真实地理
geo_3 = Geometry(<curve referenced from the Rhino model>)
panel_20 = Panel("addr:postcode,SE1 7ND")
panel_21 = Panel("amenity,cafe")
filterfieldvalue = Panel("natural,tree")
importosm = ImportOSM(Boundary=geo_3, OSMDataLocation=path_2, Clipped=True)  # -> Extents, Fields, Values, FeatureGeometry, Buildings

filterfieldvalue_2 = Panel("[Key],[Value]")

# ==== cluster Cluster
